vi "Main.gvi"   [LabVIEW NXG 2.1.0]
panel controls:
  "clear-errors": bool
panel indicators:
  "Output": error
  "tags": "Tag.gtype"[]
types:
  "DataType.gtype" = enum{"Double", "Integer", "String"}
  "Client Handle.gtype" = u32
  "Configuration.gtype" = cluster{"Server URL": string, "Session": "Client Handle.gtype"}
  "Tag.gtype" = cluster{"Path": string, "Datatype": "DataType.gtype", "Configuration": "Configuration.gtype"}
uses:
  NI::Skyline::Configuration::Open Configuration API Key (Desktop).gvi
  NI::Skyline::Configuration::Open Configuration (Desktop).gvi
  local-cloud-connector::check-for-errors.gvi
  NI::Skyline::TagHTTP::Query Tags.gvi
  NI::Skyline::TagHTTP::Open Tag.gvi
diagram:
  disable {
    frame Enabled {
      call "Open Configuration API Key (Desktop).gvi"(server url="https://api.systemlinkcloud.com", api key="aR1FfRtwtREAKnWAfp4sqwCiCxWCve82km5jf-VZgE") -> (configuration=w2, error out=w1)
    }
    frame Disabled {
      call "Open Configuration (Desktop).gvi"()
    }
  }
  w3 = "init"  # query-statemachine-states
  s1 = w3  # shift register
  s2 = w1  # shift register
  s3 = uninitialised  # shift register
  while {
    Wait(time to wait=1000)
    case (s1) {
      frame "init", Default {
        call "check-for-errors.gvi"(Error In=s2, query-statemachine-states="query") -> (Error Out=w5, query-statemachine-states_2=w4)
        w6 = s3
      }
      frame "query" {
        call "Query Tags.gvi"(paths=["*"], configuration=w2) -> (tags=w6)
        $tags <- w6
        w7 = "wait"  # query-statemachine-states
        w8 = "open tags"  # query-statemachine-states
        Is Equal[ComparisonMode=CompareAggregates](x=s3, y=w6) -> w9
        Select(s=w9, t=w7, f=w8) -> w10
        call "check-for-errors.gvi"(Error In=s2, query-statemachine-states=w10) -> (Error Out=w5, query-statemachine-states_2=w4)
      }
      frame "open tags" {
        for {
          w11 = each element of s3
          Property Node(instance in=w11) -> ("Configuration"=w12, "Path"=w13, "Datatype"=w14)
          case (w14) {
            frame "Double", Default {
              call "Open Tag.gvi"(path=w13, data type=w14, configuration=w12) -> (tag out=w15)
            }
            frame "Integer" {
              call "Open Tag.gvi"(path=w13, data type=w14, configuration=w12) -> (tag out=w15)
            }
            frame "String" {
              call "Open Tag.gvi"(path=w13, data type=w14, configuration=w12) -> (tag out=w15)
            }
          }
        }
        call "check-for-errors.gvi"(Error In=s2, query-statemachine-states="wait") -> (Error Out=w5, query-statemachine-states_2=w4)
        w6 = s3
      }
      frame "handle errors" {
        $Output <- s2
        Select(s=$"clear-errors", t=no error, f=s2) -> w16
        call "check-for-errors.gvi"(Error In=w16, query-statemachine-states="wait") -> (Error Out=w5, query-statemachine-states_2=w4)
        w6 = s3
      }
      frame "wait" {
        call "check-for-errors.gvi"(Error In=s2, query-statemachine-states="query") -> (Error Out=w5, query-statemachine-states_2=w4)
        w6 = s3
      }
    }
    next s1 = w4
    next s2 = w5
    next s3 = w6
    stop if FALSE
  }
